# Dynamo graph json_export.dyn (Dynamo 2.19.3.6394)

categories = Categories("OST_Doors")
all_elements_of_category = ElementsOfCategory(Category=categories)
parameters = Element.Parameters(element=all_elements_of_category)
string_from_array = FromArray(array=parameters)
file_path = Filename(".\params.csv")
exportCSV = Data.ExportCSV(filePath=file_path)  # unwired: data
file_path_2 = Filename(".\all.json")
setUnion = List.SetUnion()  # unwired: list1, list2
join = String.Join()  # unwired: separator, string0
join_2 = List.Join()  # unwired: list0
categories_2 = Categories("OST_Walls")
all_elements_of_category_2 = ElementsOfCategory(Category=categories_2)
parameters_2 = Element.Parameters(element=all_elements_of_category_2)
string_from_array_2 = FromArray(array=parameters_2)
stringifyJSON = Data.StringifyJSON(values=string_from_array_2)
exportCSV_2 = Data.ExportCSV(filePath=file_path, data=stringifyJSON)
